# Grasshopper definition hops1.gh (Grasshopper 1.0.7)

cir = Circle(Plane=PlaneXY(0, 0, 0), Radius="30")
A = GetInteger(AtLeast=1, AtMost=1, Maximum=2147483647, Minimum=-2147483648, Prompt="Angolo di rotazione dei cerchi")
R = GetInteger(AtLeast=1, AtMost=1, Maximum=2147483647, Minimum=-2147483648, Prompt="Raggio dei cerchi")
frames = CurveFrames(Curve=cir, Count=10)  # -> Frames, Parameters
deplane = DeconstructPlane(Plane=frames.Frames)  # -> Origin, XAxis, YAxis, ZAxis
rot3d = Rotate3D(Geometry=frames.Frames, Angle=degrees(A), Center=frames.Frames, Axis=deplane.XAxis)  # -> Geometry, Transform
cir_2 = Circle(Plane=rot3d.Geometry, Radius=R)

# ---- group: RH_OUT:B
crv = Curve(cir)

# ---- group: RH_OUT:C
crv_2 = Curve(cir_2)
